# Dynamo graph move_room_tags_to_center_v2_script.dyn (Dynamo 2.12.1.8246)

python_script = Python()  # CPython3; unwired: IN[0]
# ---------- python_script.python (62 lines) ----------
import clr
import System

clr.AddReference('RevitAPI')
clr.AddReference('RevitAPIUI')
clr.AddReference('System.Windows.Forms')  # Add reference to System.Windows.Forms
clr.AddReference('System.Drawing')
import Autodesk
from Autodesk.Revit.DB import *
from Autodesk.Revit.UI.Selection import *
from System.Windows.Forms import MessageBox  # Import MessageBox

clr.AddReference('RevitServices')
import RevitServices
from RevitServices.Persistence import DocumentManager

doc = DocumentManager.Instance.CurrentDBDocument
uidoc = DocumentManager.Instance.CurrentUIApplication.ActiveUIDocument

# Function to prompt user to select tags to exclude
def pick_tags_to_exclude():
    selection = uidoc.Selection
    picked_ref = selection.PickObjects(ObjectType.Element, "Select tags to exclude from moving:")
    return [doc.GetElement(ref_id) for ref_id in picked_ref]

# Function to center tags in rooms
def tags_to_room_center(excluded_tags):
    room_tags = FilteredElementCollector(doc, doc.ActiveView.Id).OfCategory(
                BuiltInCategory.OST_RoomTags).WhereElementIsNotElementType().ToElements()

    transaction = Transaction(doc, 'Move Room Tags on Room Points')
    transaction.Start()
    
    for room_tag in room_tags:
        # Skip tags that are in the excluded list
        if room_tag.Id in [tag.Id for tag in excluded_tags]:
            continue
        
        room_tag_pt = room_tag.Location.Point
        room = room_tag.Room
        room_pt = room.Location.Point
        new_x = room_pt.X - room_tag_pt.X
        new_y = room_pt.Y - room_tag_pt.Y
        new_z = room_pt.Z - room_tag_pt.Z

        translation = XYZ(new_x, new_y, new_z)
        room_tag.Location.Move(translation)

    transaction.Commit()

# Main
try:
    # Show a message box to the user to select tags to exclude
    MessageBox.Show("Please select the tags you want to exclude from moving. Click Finish when done.", "Select Tags")
    excluded_tags = pick_tags_to_exclude()
    tags_to_room_center(excluded_tags)
except Autodesk.Revit.Exceptions.OperationCanceledException:
    # Handle user canceling the selection
    print("Selection canceled by user.")
except Exception as e:
    # Handle other errors
    print(str(e))
# ----------------------------------------
watch = Watch(python_script)
