# Dynamo graph automatic_grids_v1_script.dyn "automatic_grids" (Dynamo 2.12.1.8246)

python_script = Python()  # CPython3; unwired: IN[0]
# ---------- python_script.python (69 lines) ----------
import clr
import System.Windows.Forms as Forms
import System.IO as IO

try:
    clr.AddReference("PresentationFramework")
except IOError:
    raise

class TextInput(Forms.Form):
    def __init__(self, title, default=None, description=None):
        self.selected = None
        self.Text = title
        # self.Height = 120

        button_panel = Forms.Panel()
        button_panel.Dock = Forms.DockStyle.Top
        self.Controls.Add(button_panel)
        
        ok_button = Forms.Button()
        ok_button.Text = 'OK'
        ok_button.DialogResult = Forms.DialogResult.OK
        ok_button.Dock = Forms.DockStyle.Right
        ok_button.AutoSize = True
        ok_button.AutoSizeMode = Forms.AutoSizeMode.GrowAndShrink
        ok_button.Width = 60  # adjust the button width here
        button_panel.Controls.Add(ok_button)

        cancel_button = Forms.Button()
        cancel_button.Text = 'Cancel'
        cancel_button.DialogResult = Forms.DialogResult.Cancel
        cancel_button.Dock = Forms.DockStyle.Right
        cancel_button.AutoSize = True
        cancel_button.AutoSizeMode = Forms.AutoSizeMode.GrowAndShrink
        cancel_button.Width = 60  # adjust the button width here
        button_panel.Controls.Add(cancel_button)
        
        if description is not None:
            label = Forms.Label()
            label.Text = description
            label.Dock = Forms.DockStyle.Top
            label.AutoSize = True
            self.Controls.Add(label)

        textbox = Forms.TextBox()
        textbox.Name = 'text_box'
        textbox.Text = default if default is not None else ''
        textbox.Dock = Forms.DockStyle.Top
        self.Controls.Add(textbox)

        self.AcceptButton = ok_button
        self.CancelButton = cancel_button
        self.StartPosition = Forms.FormStartPosition.CenterScreen

def get_user_input():
    form = TextInput('Input a number', description='Length of grid array:', default='10')
    result = form.ShowDialog()

    if result == Forms.DialogResult.OK:
        try:
            value = int(form.Controls.Find('text_box', True)[0].Text)
            return value
        except ValueError:
            return None
    else:
        return None

number = get_user_input()
OUT = number
# ----------------------------------------
python_script_2 = Python(IN[0]=python_script)  # CPython3
# ---------- python_script_2.python (83 lines) ----------
import clr
clr.AddReference('ProtoGeometry')
from Autodesk.DesignScript.Geometry import *

clr.AddReference('RevitAPI')
import Autodesk
from Autodesk.Revit.DB import *

clr.AddReference('RevitNodes')
import Revit
clr.ImportExtensions(Revit.GeometryConversion)

clr.AddReference('RevitAPIUI')
from Autodesk.Revit.UI import *
from Autodesk.Revit.UI.Selection import *
# Import RevitAPI and RevitAPIUI
clr.AddReference("RevitAPI")
clr.AddReference("RevitAPIUI")
from Autodesk.Revit.DB import *

# Get the active document
from RevitServices.Persistence import DocumentManager
clr.AddReference('RevitServices')
import RevitServices
from RevitServices.Persistence import DocumentManager

doc = DocumentManager.Instance.CurrentDBDocument
uidoc = DocumentManager.Instance.CurrentUIApplication.ActiveUIDocument

length = IN[0]

def create_horizontal_gridlines(start_point, arr_len):
    # Set initial point
    arr_len = arr_len +1
    # Generate names 1 to 9 for the grid lines
    gridline_names = [str(i) for i in range(1, arr_len)]

    # Create horizontal grid lines
    for i, name in enumerate(gridline_names):
        line_start = XYZ(start_point.X + 10 * i, start_point.Y, start_point.Z)
        line_end = XYZ(start_point.X + 10 * i, start_point.Y-10, start_point.Z)
        line = Line.CreateBound(line_end,line_start)
        level = FilteredElementCollector(doc).OfClass(Level).FirstElement()
        grid = Grid.Create(doc, line)
        grid.Name = name
        grid.Level = level.Id

def create_vertical_gridlines(start_point, arr_len):
    # Generate names for the grid lines
    gridline_names = []
    for i in range(arr_len):
        char = chr(65 + i % 26)
        if i >= 26:
            char = chr(65 + (i // 26) - 1) + chr(65 + i % 26)
        gridline_names.append(char)

    # Create vertical grid lines
    for i, name in enumerate(gridline_names):
        line_start = XYZ(start_point.X, start_point.Y - 10 * i, start_point.Z)
        line_end = XYZ(start_point.X - 10, start_point.Y - 10 * i, start_point.Z)
        line = Line.CreateBound(line_start, line_end)
        level = FilteredElementCollector(doc).OfClass(Level).FirstElement()
        grid = Grid.Create(doc, line)
        grid.Name = name
        grid.Level = level.Id


TaskDialog.Show("Info", "Pick Upper leftmost point of the plan. This will be the start point of the grid. ")
pt = uidoc.Selection.PickPoint("Pick Upper leftmost point of the plan. This will be the start point of the grid.")

# Wrap the script in a transaction
t = Transaction(doc, "Create Gridlines")
t.Start()

# Create the gridlines
create_horizontal_gridlines(pt, length)
create_vertical_gridlines(pt, length)

# Commit the transaction and output a message
t.Commit()
print("Grid lines created successfully.")

OUT = pt
# ----------------------------------------
watch = Watch(python_script_2)
