# Dynamo graph automatic_line_grid_v1_script.dyn (Dynamo 2.12.1.8246)

get_selected_points = Python()  # CPython3; unwired: IN[0]
# ---------- get_selected_points.python (37 lines) ----------
import clr
clr.AddReference('ProtoGeometry')
from Autodesk.DesignScript.Geometry import *

clr.AddReference('RevitAPI')
import Autodesk
from Autodesk.Revit.DB import *

clr.AddReference('RevitNodes')
import Revit
clr.ImportExtensions(Revit.GeometryConversion)

clr.AddReference('RevitAPIUI')
from Autodesk.Revit.UI import *
from Autodesk.Revit.UI.Selection import *
# Import RevitAPI and RevitAPIUI
clr.AddReference("RevitAPI")
clr.AddReference("RevitAPIUI")
from Autodesk.Revit.DB import *

# Get the active document
from RevitServices.Persistence import DocumentManager
clr.AddReference('RevitServices')
import RevitServices
from RevitServices.Persistence import DocumentManager

doc = DocumentManager.Instance.CurrentDBDocument
uidoc = DocumentManager.Instance.CurrentUIApplication.ActiveUIDocument

TaskDialog.Show("Info", "Pick Upper leftmost point of the plan. This will be the start point of the grid. ")
upper_left_pt = uidoc.Selection.PickPoint("Pick Upper leftmost point of the plan. This will be the start point of the grid.")

TaskDialog.Show("Info", "Pick Lower rightmost point of the plan. This will be the end point of the grid. ")
lower_right_pt = uidoc.Selection.PickPoint("Pick Lower rightmost point of the plan. This will be the end point of the grid.")


OUT = upper_left_pt, lower_right_pt
# ----------------------------------------
generate_line_grid = Python(IN[0]=get_selected_points)  # CPython3; unwired: IN[1]
# ---------- generate_line_grid.python (152 lines) ----------
import clr

# Import RevitAPI
clr.AddReference('RevitAPI')
from Autodesk.Revit.DB import *

# Import DocumentManager and TransactionManager
clr.AddReference('RevitServices')
import RevitServices
from RevitServices.Persistence import DocumentManager
from RevitServices.Transactions import TransactionManager

import Autodesk
from Autodesk.Revit.DB import *

# Import ProtoGeometry for Dynamo interoperability
clr.AddReference('ProtoGeometry')
from Autodesk.DesignScript.Geometry import Point

# Import ToRevitType for geometry conversion
clr.AddReference('RevitNodes')
import Revit
clr.ImportExtensions(Revit.GeometryConversion)

clr.AddReference('RevitAPIUI')
from Autodesk.Revit.UI import *
from Autodesk.Revit.UI.Selection import *

doc = DocumentManager.Instance.CurrentDBDocument
uidoc = DocumentManager.Instance.CurrentUIApplication.ActiveUIDocument

# Import the .NET List
clr.AddReference('System')
from System.Collections.Generic import List

# Function to generate letter labels (A, B, ..., Z, AA, AB, ...)
def generate_letter_labels(num):
    labels = []
    for i in range(num):
        quotient, remainder = divmod(i, 26)
        if quotient > 0:
            labels.append(chr(64 + quotient) + chr(65 + remainder))
        else:
            labels.append(chr(65 + remainder))
    return labels

# Define the top left and bottom right points to test
# topLeft = Point.ByCoordinates(-12.591071277, 129.487292193, 0.000000000)
# bottomRight = Point.ByCoordinates(50.648512056, 88.565417193, 0.000000000)

# Convert points from Dynamo to Revit types
# topLeft = topLeft.ToXyz()
# bottomRight = bottomRight.ToXyz()

# TaskDialog.Show("Info", "Pick the top left corner of where the grid should start.")
# topLeft = uidoc.Selection.PickPoint("Pick the top left corner of where the grid should start.")

# TaskDialog.Show("Info", "Pick the bottom right corner of where the grid should end.")
# bottomRight = uidoc.Selection.PickPoint("Pick the bottom right corner of where the grid should end.")
pts = IN[0]
topLeft = pts[0]
bottomRight = pts[1]

# Define the grid size in feet (10 feet)
gridSize = 10.0

# Calculate the number of cells in the X and Y directions
numX = int((bottomRight.X - topLeft.X) / gridSize)
numY = int((topLeft.Y - bottomRight.Y) / gridSize)

# Get the current document
doc = DocumentManager.Instance.CurrentDBDocument

# Get the red line style
line_style = FilteredElementCollector(doc).OfClass(GraphicsStyle).ToElements()
red_line_style = [style for style in line_style if style.Name == '01 - Ultra Light Red'][0]

# Get the default text note type (you may need to adjust this to match your document's text types)
text_note_type_id = doc.GetDefaultElementTypeId(ElementTypeGroup.TextNoteType)

# Start a transaction
TransactionManager.Instance.EnsureInTransaction(doc)

# Lists to keep track of created elements' IDs
detail_lines_ids = []
text_notes_ids = []

# Generate letter labels for the horizontal lines
letter_labels = generate_letter_labels(numY + 1)

# Create the horizontal grid lines and add text notes
for i, label in enumerate(letter_labels):
    startH = XYZ(topLeft.X, topLeft.Y - i * gridSize, 0)
    endH = XYZ(bottomRight.X, topLeft.Y - i * gridSize, 0)
    lineH = Line.CreateBound(startH, endH)
    detail_lineH = doc.Create.NewDetailCurve(doc.ActiveView, lineH)
    detail_lineH.LineStyle = red_line_style
    
    # Create text note at the start of each horizontal line
    text_position = XYZ(startH.X - gridSize * 0.5, startH.Y, 0)  # Adjust X position slightly to the left of the line
    text_note = TextNote.Create(doc, doc.ActiveView.Id, text_position, label, text_note_type_id)
    
    # After creating each detail line and text note, store their IDs
    detail_lines_ids.append(detail_lineH.Id)
    text_notes_ids.append(text_note.Id)

# Create the vertical grid lines and add text notes
for j in range(numX + 1):
    startV = XYZ(topLeft.X + j * gridSize, topLeft.Y, 0)
    endV = XYZ(topLeft.X + j * gridSize, bottomRight.Y, 0)
    lineV = Line.CreateBound(startV, endV)
    detail_lineV = doc.Create.NewDetailCurve(doc.ActiveView, lineV)
    detail_lineV.LineStyle = red_line_style
    
    # Create text note at the top of each vertical line
    text_position = XYZ(startV.X, startV.Y + gridSize * 0.6, 0)  # Adjust Y position slightly above the line
    text_note = TextNote.Create(doc, doc.ActiveView.Id, text_position, str(j + 1), text_note_type_id)
    
    # After creating each detail line and text note, store their IDs
    detail_lines_ids.append(detail_lineV.Id)
    text_notes_ids.append(text_note.Id)

# Combine the lists of ElementIds
element_ids = detail_lines_ids + text_notes_ids

# Ensure input is a list
if not isinstance(element_ids, list):
    element_ids = [element_ids]

# Convert input IDs to ElementId objects if they are not already
element_ids = [ElementId(id.IntegerValue) if isinstance(id, ElementId) else ElementId(id) for id in element_ids]

# Convert Python list to .NET List[ElementId]
element_id_list = List[ElementId](element_ids)

# # Start a transaction to modify the document
# TransactionManager.Instance.EnsureInTransaction(doc)

# Create a new group with the elements
try:
    new_group = doc.Create.NewGroup(element_id_list)
    message = "Group created with {} elements.".format(len(element_id_list))
except Exception as e:
    new_group = []
    message = "Failed to create group: " + str(e)


# End the transaction
TransactionManager.Instance.TransactionTaskDone()

# Output the lists of element IDs (if needed for further processing)
OUT = detail_lines_ids, element_id_list
# ----------------------------------------
watch = Watch(generate_line_grid)
