# Dynamo graph renumber_doors_v3_script.dyn (Dynamo 2.12.1.8246)

categories = Categories("OST_Doors")  # graph input
all_elements_of_category = ElementsOfCategory(Category=categories)
# note: I am using ToRoom and FromRoom but swapping the door direction doesn't update that if the door family (like the UNI one) doesn't have a calculation point
python_script = Python(IN[0]=all_elements_of_category)  # CPython3
# ---------- python_script.python (103 lines) ----------
import clr
# Import RevitAPI
clr.AddReference("RevitAPI")
import Autodesk
from Autodesk.Revit.DB import *

# Import DocumentManager and TransactionManager
clr.AddReference("RevitServices")
import RevitServices
from RevitServices.Persistence import DocumentManager
from RevitServices.Transactions import TransactionManager

# Import ToDSType(bool) extension method
clr.AddReference("RevitNodes")
import Revit
clr.ImportExtensions(Revit.Elements)
 
# Start Transaction
doc = DocumentManager.Instance.CurrentDBDocument

fam_inst = IN[0]

elements = []
for i in IN[0]:
 elements.append(UnwrapElement(i))

def TryGetToRoom(room, phase):
 try:
    toRoom = room.get_ToRoom(phase)
 except:
    toRoom = None
    pass
 return toRoom

def TryGetFromRoom(room, phase):
 try:
    fromRoom = room.get_FromRoom(phase)
 except:
    fromRoom = None
    pass
 return fromRoom

def append_letter(room_numbers_list, room_number):
    '''If a room number already exists add a suffix to it. Not the best way of doing this..'''
    # Check if the room number is already in the list
    if room_number in room_numbers_list:
        # If it is, loop through the letters A to Z and find the first one that is not already in the list
        for letter in "ABCDEFGHIJKLMNOPQRSTUVWXYZ":
            new_room_number = room_number + letter
            if new_room_number not in room_numbers_list:
                return new_room_number
            elif letter == "Z":
                # If the increment reaches "Z", loop back to "A" and double up the previous letter
                for prev_letter in "ABCDEFGHIJKLMNOPQRSTUVWXYZ":
                    if prev_letter != "Z":
                        new_room_number = room_number[:-1] + prev_letter + "Z"
                        if new_room_number not in room_numbers_list:
                            return new_room_number
        # If all letters have been used, return the duplicate room_number. If this happens you've got more problems than duplicate room numbers
        return room_number
    else:
        # If the room number is not in the list, return it as-is
        return room_number


room_number, room_name, doors, room = [], [], [], []
for i in elements:
 for phase in doc.Phases:
    if i.CreatedPhaseId == phase.Id:
     for phase2 in doc.Phases:
        if TryGetToRoom(i, phase2) != None:
         to_room = TryGetToRoom(i, phase2)
         break
        else:
         to_room = None
     for phase3 in doc.Phases:
        if TryGetFromRoom(i, phase3) != None:
         from_room = TryGetFromRoom(i, phase3)
         break
        else:
         from_room = None

     if from_room == None and to_room == None:
        room_number.append(None)
        room_name.append(None)
        doors.append(None)
     elif to_room != None:
        Numbers = to_room.GetParameters("Number")
        Names = to_room.GetParameters("Name")
        
        flattened_number = Numbers[0].AsString()
        flattened_name = Names[0].AsString()

        room_number.append(append_letter(room_number, flattened_number))
        room_name.append(flattened_name)

        # for n in range(len(Numbers)):
        #   room_number.append(Numbers[n].AsString())
        #   room_name.append(Names[n].AsString())
        doors.append(i)
        room.append(to_room)

OUT = room_number, room_name, doors, room
# ----------------------------------------
code_block = CodeBlock(IN=python_script) { roomNumber = IN[0]; roomName = IN[1]; Doors = IN[2]; Rooms = IN[3]; }
watch = Watch(code_block.roomNumber)
code_block_2 = CodeBlock { "Mark"; }
setParameterByName = Element.SetParameterByName(element=code_block.Doors, parameterName=code_block_2, value=code_block.roomNumber)
watch_2 = Watch()  # unwired: arg0
watch_3 = Watch()  # unwired: arg0
