# Dynamo graph renumber_rooms_v2_script.dyn (Dynamo 2.12.1.8246)
# packages: Clockwork for Dynamo 1.x 1.31.1

# group: Testing
all_elements_of_category = ElementsOfCategory()  # unwired: Category
number = DoubleInput(194)
categories = Categories("OST_Rooms")

# group: Filter unplaced rooms
area = Room.Area(room=all_elements_of_category)
number_2 = DoubleInput(0)
ne = area != number_2
filterByBoolMask = List.FilterByBoolMask(list=all_elements_of_category, mask=ne)

# group (continued): Testing
level = Custom[Element.Level](element=filterByBoolMask.in)  # package Clockwork for Dynamo 1.x; Gets an element's level
getItemAtIndex = List.GetItemAtIndex(list=level, index=number)
name = Level.Name(level=getItemAtIndex)

watch = Watch(name)

# group: Get Room info
categories_2 = Categories("OST_Rooms")
all_elements_of_category_2 = ElementsOfCategory(Category=categories_2)
code_block = CodeBlock { "Level"; }

# group: Filter Out Unplaced Rooms
area_2 = Room.Area(room=all_elements_of_category_2)
number_3 = DoubleInput(0)
ne_2 = area_2 != number_3
filterByBoolMask_2 = List.FilterByBoolMask(list=all_elements_of_category_2, mask=ne_2)

# group (continued): Get Room info
get_room_location_coordinates = Element.GetLocation(element=filterByBoolMask_2.in)
get_level_name = Element.GetParameterValueByName(element=filterByBoolMask_2.in, parameterName=code_block, lacing=Longest)

spacing_of_the_grid_in_feet = DoubleInput(10)
number_4 = Room.Number(room=filterByBoolMask_2.in)

# group: The Brains
code_block_2 = CodeBlock()
# ---------- code_block_2.designscript (6 lines) ----------
// IN[0] -> Coordinates of the rooms
// IN[1] -> Grid Spacing
// IN[2] -> Level Name of the room;
// IN[3] -> Orig Name of the room;

// OUT[0] -> A list of the new room numbers
# ----------------------------------------
room_to_name = Python(IN[0]=get_room_location_coordinates, IN[1]=spacing_of_the_grid_in_feet, IN[2]=get_level_name, IN[3]=number_4)  # CPython3
# ---------- room_to_name.python (189 lines) ----------
# Load the Python Standard and DesignScript Libraries
import sys
import clr
clr.AddReference('ProtoGeometry')
from Autodesk.DesignScript.Geometry import *
import math
clr.AddReference('RevitAPI')
import Autodesk
from Autodesk.Revit.DB import *

clr.AddReference('RevitNodes')
import Revit
clr.ImportExtensions(Revit.GeometryConversion)

clr.AddReference('RevitAPIUI')
from Autodesk.Revit.UI import *
from Autodesk.Revit.UI.Selection import *

clr.AddReference('RevitServices')
import RevitServices
from RevitServices.Persistence import DocumentManager

clr.AddReference('System.Windows.Forms')
from System.Windows.Forms import MessageBox, MessageBoxButtons, MessageBoxIcon, DialogResult

doc = DocumentManager.Instance.CurrentDBDocument
uidoc = DocumentManager.Instance.CurrentUIApplication.ActiveUIDocument


# The inputs to this node will be stored as a list in the IN variables.
dataEnteringNode = IN
      
# INPUTS      
# these are lists of points
room_coordinates = IN[0]
# these are lists of strings
levels = IN[2]

#this is a manually set constant
grid_spacing = IN[1]

original_room_names = IN[3]

class Point:
    '''Dummy class similar to a Revit point '''
    def __init__(self, x, y):
        self.X = x
        self.Y = y

    
    def __str__(self):
        return f"({self.x}, {self.y})"


# Ask if drawings have been issued to consultants. If yes 
issuance_result = MessageBox.Show('Have drawings been issued to consultants yet? If yes mass room renumbering should not be done to avoid coordination confusion.', 'Confirmation', MessageBoxButtons.YesNo, MessageBoxIcon.Question)

if issuance_result == DialogResult.Yes:
    OUT = original_room_names
    # exit(0)
else:
    # ask the user to select the start point for the grid and grab the XY coords of that click
    TaskDialog.Show("Info", "Pick Upper leftmost point of the plan. This will be the start point of the grid. No rooms should be North or West of this point.")
    point_top_left = uidoc.Selection.PickPoint("Pick Upper leftmost point of the plan. This will be the start point of the grid. No rooms should be North or West of this point.")

    #calculate the origin point of the 10' grid. This is where we need to start to measure from 
    # point_top_left = Point(bb_min_pt_coordinates.X, bb_max_pt_coordinates.Y)


    def extract_floor_number(s):
        '''Extract the floor number from a string like "Level 1" '''
        # Initialize an empty string to store the digits
        digits = ""
        
        # Loop through each character in the string
        for char in s:
            # If the character is a digit, add it to the digits string
            if char.isdigit():
                digits += char
            # If the character is not a digit and we have already found some digits, break out of the loop
            elif digits:
                break
        if digits and digits[0] == '0':
            return digits
        if digits and int(digits) < 10:
            return "0%s" % digits
        # If we found some digits, convert them to an integer and return them
        if digits:
            return digits
        # If no digits were found, return None
        else:
            return None

    def number_to_letter(num):
        '''Given a number convert it to a letter'''
        # Define the alphabet
        alphabet = 'ABCDEFGHIJKLMNOPQRSTUVWXYZ'
        num = math.ceil(num)
        # Initialize the result string
        result = ''
        
        # Loop until the number is zero
        while num > 0:
            # Subtract 1 from the number to convert to zero-indexed
            num -= 1
            
            # Get the remainder of the number divided by 26
            remainder = num % 26
            
            # Add the corresponding letter to the result string
            result = alphabet[remainder] + result
            
            # Divide the number by 26 and round down to the nearest integer
            num = int(num / 26)
        
        # Return the result string
        return result

    def room_x_axis_name(room_point):
        # take the x coordinate of the room subtract the top left BB coordinate
        # this finds the distance the room is (in the X axis) from the top left origin
        # then divide by grid_spacing (typically 10ft) to find how many grid zones over the room is
        # do ABS and round up because MATH 
        # if below 10 pad the number for readability

        room_name_x = (room_point.X - point_top_left.X) / grid_spacing
        room_name_x = abs(room_name_x)
        room_name_x = math.ceil(room_name_x)
        if room_name_x < 10:
            return "0%s" % room_name_x

        else:
            return str(room_name_x)

    def room_y_axis_name(room_point):
        # take the x coordinate of the room subtract the top left BB coordinate
        # this finds the distance the room is (in the X axis) from the top left origin
        # then divide by grid_spacing (typically 10ft) to find how many grid zones over the room is
        # do ABS to convert a negative to a positive because MATH 
        # convert to letter format (AA, F, etc)

        room_name_y = (room_point.Y - point_top_left.Y) / grid_spacing
        room_name_y = abs(room_name_y)
        room_name_y = number_to_letter(room_name_y)
        return room_name_y

    def append_letter(room_numbers_list, room_number):
        '''If a room number already exists add a suffix to it'''
        # Check if the room number is already in the list
        if room_number in room_numbers_list:
            # If it is, loop through the letters A to Z and find the first one that is not already in the list
            for letter in "ABCDEFGHIJKLMNOPQRSTUVWXYZ":
                new_room_number = room_number + letter
                if new_room_number not in room_numbers_list:
                    return new_room_number
            # If all letters have been used, return the duplicate room_number. If this happen you've got more problems than duplicate room numbers...
            return room_number
        else:
            # If the room number is not in the list, return it as-is
            return room_number
            
    # list of new room names
    new_room_names = []
    # ask if the project is on multiple levels

    # loop through all rooms and calculate their name
    confirm_result = MessageBox.Show('Does this project have work on multiple floors? If yes the level number will be added to each room name.', 'Confirmation', MessageBoxButtons.YesNo, MessageBoxIcon.Question)

    if confirm_result == DialogResult.Yes:
        # Do something if Yes is clicked
        output = True
    else:
        # Do something if No is clicked
        output = False


    for index, room in enumerate(room_coordinates):
        if output==True:
            level_name = extract_floor_number(levels[index])
            room_name = level_name+ room_y_axis_name(room) + room_x_axis_name(room) 
        else:
            room_name = room_y_axis_name(room) + room_x_axis_name(room) 
        # check if the room name exists and if so add a suffix
        room_name = append_letter(new_room_names, room_name)
        
        new_room_names.append(room_name)
    
    # Return the list of new room names
    OUT = new_room_names
# ----------------------------------------

setNumber = Room.SetNumber(room=filterByBoolMask_2.in, value=room_to_name)
watch_2 = Watch(get_room_location_coordinates)
watch_3 = Watch(room_to_name)
