# Dynamo graph renumber_viewports_by_location_v3_script.dyn (Dynamo 2.12.1.8246)

# group: Number of Cells
# note: GridX
# note: GridY
code_block = CodeBlock { 5; }
code_block_2 = CodeBlock { 6; }

# group: Get the active sheet and viewports
current = Document.Current()
activeView = Document.ActiveView(document=current)
viewports = Sheet.Viewports(sheet=activeView)

boxOutline = Viewport.BoxOutline(viewport=viewports)
maxPoint = BoundingBox.MaxPoint(boundingBox=boxOutline)

# group: Get the size of the active sheet
python_script = Python(IN[0]=activeView)  # CPython3
# ---------- python_script.python (31 lines) ----------
#Alban de Chasteigner 2021
#twitter : @geniusloci_bim
#geniusloci.bim@gmail.com
#https://github.com/albandechasteigner/GeniusLociForDynamo

import clr
clr.AddReference('RevitAPI')
from Autodesk.Revit.DB import FilteredElementCollector,BuiltInParameter,BuiltInCategory

sheets = UnwrapElement(IN[0]) if isinstance(IN[0],list) else [UnwrapElement(IN[0])]

def convert_dimension_to_feet(dimension):
    feet, inches = dimension.split("'")
    feet = float(feet.strip())
    inches = inches.strip().replace('"', '').replace('-', '')
    print(inches.strip())
    inches = float(inches)
    total_feet = feet + (inches / 12)
    return total_feet

width,height=[],[]
for sheet in sheets:
	doc=sheet.Document
	title=FilteredElementCollector(doc,sheet.Id).OfCategory(BuiltInCategory.OST_TitleBlocks).FirstElement()
	width.append(title.get_Parameter(BuiltInParameter.SHEET_WIDTH).AsValueString())
	height.append(title.get_Parameter(BuiltInParameter.SHEET_HEIGHT).AsValueString())

if isinstance(IN[0], list):
    OUT = convert_dimension_to_feet(width),convert_dimension_to_feet(height)
else: 
    OUT =convert_dimension_to_feet(width[0]), convert_dimension_to_feet(height[0])
# ----------------------------------------
code_block_3 = CodeBlock(x=python_script) { x[0]; x[1]; }
code_block_4 = CodeBlock(Width=code_block_3.out0) { Width; }
code_block_5 = CodeBlock(Height=code_block_3.out1) { Height; }

# group: Width of a cell
left_offset_in_the_x = CodeBlock { 0.2291667; }
sub = code_block_4 - left_offset_in_the_x
div = sub / code_block_2

# group: Divide viewports x value by cell size to identify location
X = Point.X(point=maxPoint)
div_2 = X / div  # lacing=Longest
code_block_6 = CodeBlock(x=div_2) { x+1; }
floor = Math.Floor(number=code_block_6)

reverse_the_x_matrix = Python(IN[0]=code_block_2, IN[1]=floor)  # CPython3
# ---------- reverse_the_x_matrix.python (27 lines) ----------
# Load the Python Standard and DesignScript Libraries
import sys
import clr
clr.AddReference('ProtoGeometry')
from Autodesk.DesignScript.Geometry import *

# The inputs to this node will be stored as a list in the IN variables.
dataEnteringNode = IN
column_total = IN[0]
column_number = IN[1]
new_column_number = []
# Place your code below this line
def invert_column_number(column_number, num_columns):

    inverted_column = (num_columns - column_number) % num_columns
    return inverted_column

for c in column_number:
    if c==0:
            new_number=column_total
    else:
        new_number = invert_column_number(c, column_total)
    
    new_column_number.append(new_number)

# Assign your output to the OUT variable.
OUT = new_column_number
# ----------------------------------------

# group: Height of a cell
bottom_offset_y = CodeBlock { 0.04134114583333; }
sub_2 = code_block_5 - bottom_offset_y
div_3 = sub_2 / code_block

# group: Divide viewports x value by cell size to identify location
Y = Point.Y(point=maxPoint)
div_4 = Y / div_3  # lacing=Longest
code_block_7 = CodeBlock(y=div_4) { y+1; }
floor_2 = Math.Floor(number=code_block_7)

reverse_the_y_matrix = Python(IN[0]=code_block, IN[1]=floor_2)  # CPython3
# ---------- reverse_the_y_matrix.python (23 lines) ----------
# Load the Python Standard and DesignScript Libraries
import sys
import clr
clr.AddReference('ProtoGeometry')
from Autodesk.DesignScript.Geometry import *

# The inputs to this node will be stored as a list in the IN variables.
dataEnteringNode = IN
column_total = IN[0]
column_number = IN[1]
new_column_number = []
# Place your code below this line
def invert_column_number(column_number, num_columns):

    inverted_column = (num_columns - column_number) % num_columns
    return inverted_column

for c in column_number:
    new_number = invert_column_number(c, column_total) +1
    new_column_number.append(new_number)

# Assign your output to the OUT variable.
OUT = new_column_number
# ----------------------------------------
calculate_grid_number = Python(IN[0]=code_block, IN[1]=reverse_the_x_matrix, IN[2]=reverse_the_y_matrix)  # CPython3
# ---------- calculate_grid_number.python (22 lines) ----------
# Load the Python Standard and DesignScript Libraries
import sys
import clr
clr.AddReference('ProtoGeometry')
from Autodesk.DesignScript.Geometry import *

# The inputs to this node will be stored as a list in the IN variables.
dataEnteringNode = IN
total_rows = IN[0]
column_numbers = IN[1]
row_numbers = IN[2]
new_cell_numbers = []


for index, column_number in enumerate(column_numbers):
	
	cell_number = str((total_rows) * (column_number-1) + row_numbers[index])
	new_cell_numbers.append(cell_number)
# Place your code below this line

# Assign your output to the OUT variable.
OUT = new_cell_numbers
# ----------------------------------------
watch = Watch(calculate_grid_number)

# group: Set temporary detail numbers to avoid dupicates
code_block_8 = CodeBlock { "Detail Number"; }
getParameterValueByName = Element.GetParameterValueByName(element=viewports, parameterName=code_block_8)
code_block_9 = CodeBlock { "dup"; }
code_block_10 = CodeBlock(a=getParameterValueByName, b=code_block_9) { a+b; }
setParameterByName = Element.SetParameterByName(element=viewports, parameterName=code_block_8, value=code_block_10)

watch_2 = Watch(getParameterValueByName)
code_block_11 = CodeBlock { "Detail Number"; }
getParameterValueByName_2 = Element.GetParameterValueByName(element=setParameterByName, parameterName=code_block_11)
watch_3 = Watch(getParameterValueByName_2)
sheetName = Sheet.SheetName(sheet=activeView)
watch_4 = Watch(sheetName)
code_block_12 = CodeBlock {  }

# group: Make sure dummy numbers are set first before the new numbers. Waits for waitfor to complete before passthrough is run
sequential_passthrough = CodeBlock(passthrough=viewports, waitfor=getParameterValueByName_2) { [passthrough,waitfor][0]; }

code_block_13 = CodeBlock { "Detail Number"; }
setParameterByName_2 = Element.SetParameterByName(element=sequential_passthrough, parameterName=code_block_13, value=calculate_grid_number)
watch_5 = Watch(setParameterByName_2)
watch_6 = Watch(reverse_the_y_matrix)
watch_7 = Watch(reverse_the_x_matrix)
watch_8 = Watch(floor)
watch_9 = Watch(floor_2)
watch_10 = Watch(code_block_6)
