# Dynamo graph renumber_viewports_by_selection_v1_script.dyn (Dynamo 2.12.1.8246)

# note: CREATED BY: Matthew Vogel
# CREATED: <20230531>
# VERSION 1.5
# LAST EDITED: <20230531>
# DYNAMO VERSION: 2.12
# PACKAGES:
# None
# NOTES:
# Renumber Views on a sheets based on selection order
get_viewports_by_selection = Python()  # CPython3; unwired: IN[0]
# ---------- get_viewports_by_selection.python (67 lines) ----------
import clr
import sys
import System

clr.AddReference('RevitAPI')
import Autodesk
from Autodesk.Revit.DB import *
import Autodesk.Revit.DB as DB

clr.AddReference('RevitAPIUI')
from Autodesk.Revit.UI import *
from Autodesk.Revit.UI.Selection import *

from System.Collections.Generic import List

clr.AddReference('RevitServices')
import RevitServices
from RevitServices.Persistence import DocumentManager
from RevitServices.Transactions import TransactionManager
doc = DocumentManager.Instance.CurrentDBDocument
uiapp = DocumentManager.Instance.CurrentUIApplication
uidoc = uiapp.ActiveUIDocument

def overridecolor(elementId, reset = False):
	t = Transaction(doc, "Selection")
	t.Start()
	view = doc.ActiveView
	color_rgb = DB.Color(30,144,255)
	gSettings = OverrideGraphicSettings()
	if not reset: 
		gSettings.SetSurfaceForegroundPatternColor(color_rgb) 
		gSettings.SetProjectionLineColor(color_rgb)
		gSettings.SetCutLineColor(color_rgb)
		gSettings.SetCutForegroundPatternColor(color_rgb)
		gSettings.SetProjectionLineWeight(8)
	view.SetElementOverrides(elementId, gSettings)
	doc.Regenerate()
	uidoc.RefreshActiveView()
	t.Commit()
	t.Dispose()
			
		
flag = True
selectId = []
TransactionManager.Instance.ForceCloseTransaction()
TaskDialog.Show('Selection', 'Select viewports in the order that you want them renumbered and re-select an item to remove it. Hit ESC when you are done picking. All viewports on the sheet must be selected to avoid naming clashes.')
tg = TransactionGroup(doc, "Selection")
tg.Start()

while flag:
	try:
		ref = uidoc.Selection.PickObject(ObjectType.Element, 'Pick elements in the desired order (re-select to Remove), hit ESC to stop picking.')
		e_id = ref.ElementId
		if e_id not in selectId:
			overridecolor(e_id)
			selectId.append(e_id)
		else:
			overridecolor(e_id, True)
			selectId.pop(selectId.index(e_id))
			
	except Exception as ex:
		flag = False
		break		
tg.RollBack()
elemenSelect = [doc.GetElement(xId) for xId in selectId]

OUT = elemenSelect
# ----------------------------------------

# group: Creates the new Detail Numbers
count = List.Count(list=get_viewports_by_selection)
code_block = CodeBlock(x=count) { 1..x; }
string_from_object = FromObject(object=code_block)

watch = Watch(string_from_object)

# group: Numbers Each Viewport with a unique Number that will not be used in the final Numbering. "Current Detail Number + DUP"
code_block_2 = CodeBlock { "Detail Number"; }
getParameterValueByName = Element.GetParameterValueByName(element=get_viewports_by_selection, parameterName=code_block_2)
code_block_3 = CodeBlock(x=getParameterValueByName) { x+"DUP"; }
setParameterByName = Element.SetParameterByName(element=get_viewports_by_selection, parameterName=code_block_2, value=code_block_3)

code_block_4 = CodeBlock { "Detail Number"; }

# group: Sets the Final Detail Number
setParameterByName_2 = Element.SetParameterByName(element=setParameterByName, parameterName=code_block_4, value=string_from_object)

watch_2 = Watch(get_viewports_by_selection)
code_block_5 = CodeBlock { "View Name"; }
getParameterValueByName_2 = Element.GetParameterValueByName(element=setParameterByName, parameterName=code_block_5)
watch_3 = Watch(getParameterValueByName_2)
getParameterValueByName_3 = Element.GetParameterValueByName(element=get_viewports_by_selection, parameterName=code_block_5)
watch_4 = Watch(getParameterValueByName_3)
