# Dynamo graph renumber_rooms_script.dyn "renumber rooms" (Dynamo 2.12.1.8246)
# packages: Clockwork for Dynamo 1.x 1.31.1

# group: Bounding Box of entire floor
categories = Categories("OST_Walls")
current = Document.Current()
activeView = Document.ActiveView(document=current)
all_elements_of_category_in_view = ElementsOfCategoryInView(Category=categories, View=activeView)
solids = Element.Solids(element=all_elements_of_category_in_view)
flatten = List.Flatten(list=solids)
byUnion = Solid.ByUnion(solids=flatten)
boundingBox = Geometry.BoundingBox(geometry=byUnion)
minPoint = BoundingBox.MinPoint(boundingBox=boundingBox)
maxPoint = BoundingBox.MaxPoint(boundingBox=boundingBox)
code_block = CodeBlock()
# ---------- code_block.designscript (2 lines) ----------
// this active view doesn't always update unless dynamo is refreshed
// or Document.Current is re-linked to Document.ActiveView
# ----------------------------------------

byStartPointEndPoint = Line.ByStartPointEndPoint(startPoint=minPoint, endPoint=maxPoint)

# group: Get Room info
categories_2 = Categories("OST_Rooms")
all_elements_of_category = ElementsOfCategory(Category=categories_2)
get_room_location_coordinates = Element.GetLocation(element=all_elements_of_category)
code_block_2 = CodeBlock { "Level"; }
get_level_name = Element.GetParameterValueByName(element=all_elements_of_category, parameterName=code_block_2, lacing=Longest)

spacing_of_the_grid_in_feet = DoubleInput(10)

# group: The Brains
room_to_name = Python(IN[0]=get_room_location_coordinates, IN[1]=minPoint, IN[2]=spacing_of_the_grid_in_feet, IN[3]=maxPoint, IN[4]=get_level_name)  # CPython3
# ---------- room_to_name.python (143 lines) ----------
# Load the Python Standard and DesignScript Libraries
import sys
import clr
clr.AddReference('ProtoGeometry')
from Autodesk.DesignScript.Geometry import *
import math
# The inputs to this node will be stored as a list in the IN variables.
dataEnteringNode = IN
      
# INPUTS      
# these are lists of points
room_coordinates = IN[0]
# these are lists of strings
levels = IN[4]

#this is a manually set constant
grid_spacing = IN[2]
#these are points
bb_min_pt_coordinates = IN[1]
bb_max_pt_coordinates = IN[3]

class Point:
    '''Dummy class similar to a Revit point '''
    def __init__(self, x, y):
        self.X = x
        self.Y = y

    
    def __str__(self):
        return f"({self.x}, {self.y})"
  
#calculate the origin point of the 10' grid. This is where we need to start to measure from 
point_top_left = Point(bb_min_pt_coordinates.X, bb_max_pt_coordinates.Y)


def extract_floor_number(s):
    '''Extract the floor number from a string like "Level 1" '''
    # Initialize an empty string to store the digits
    digits = ""
    
    # Loop through each character in the string
    for char in s:
        # If the character is a digit, add it to the digits string
        if char.isdigit():
            digits += char
        # If the character is not a digit and we have already found some digits, break out of the loop
        elif digits:
            break
    if int(digits) < 10:
        return "0%s" % digits
    # If we found some digits, convert them to an integer and return them
    if digits:
        return digits
    # If no digits were found, return None
    else:
        return None

def number_to_letter(num):
    '''Given a number convert it to a letter'''
    # Define the alphabet
    alphabet = 'ABCDEFGHIJKLMNOPQRSTUVWXYZ'
    num = math.ceil(num)
    # Initialize the result string
    result = ''
    
    # Loop until the number is zero
    while num > 0:
        # Subtract 1 from the number to convert to zero-indexed
        num -= 1
        
        # Get the remainder of the number divided by 26
        remainder = num % 26
        
        # Add the corresponding letter to the result string
        result = alphabet[remainder] + result
        
        # Divide the number by 26 and round down to the nearest integer
        num = int(num / 26)
    
    # Return the result string
    return result

def room_x_axis_name(room_point):
    # take the x coordinate of the room subtract the top left BB coordinate
    # this finds the distance the room is (in the X axis) from the top left origin
    # then divide by grid_spacing (typically 10ft) to find how many grid zones over the room is
    # do ABS and round up because MATH 
    # if below 10 pad the number for readability

    room_name_x = (room_point.X - point_top_left.X) / grid_spacing
    room_name_x = abs(room_name_x)
    room_name_x = math.ceil(room_name_x)
    if room_name_x < 10:
        return "0%s" % room_name_x

    else:
        return str(room_name_x)

def room_y_axis_name(room_point):
    # take the x coordinate of the room subtract the top left BB coordinate
    # this finds the distance the room is (in the X axis) from the top left origin
    # then divide by grid_spacing (typically 10ft) to find how many grid zones over the room is
    # do ABS to convert a negative to a positive because MATH 
    # convert to letter format (AA, F, etc)

    room_name_y = (room_point.Y - point_top_left.Y) / grid_spacing
    room_name_y = abs(room_name_y)
    room_name_y = number_to_letter(room_name_y)
    return room_name_y

def append_letter(room_numbers_list, room_number):
    '''If a room number already exists add a suffix to it'''
    # Check if the room number is already in the list
    if room_number in room_numbers_list:
        # If it is, loop through the letters A to Z and find the first one that is not already in the list
        for letter in "ABCDEFGHIJKLMNOPQRSTUVWXYZ":
            new_room_number = room_number + letter
            if new_room_number not in room_numbers_list:
                return new_room_number
        # If all letters have been used, return the duplicate room_number. If this happen you've got more problems than duplicate room numbers...
        return room_number
    else:
        # If the room number is not in the list, return it as-is
        return room_number
        
# list of new room names
new_room_names = []

# loop through all rooms and calculate their name
for index, room in enumerate(room_coordinates):
    level_name = extract_floor_number(levels[index])
    room_name = level_name+ room_y_axis_name(room) + room_x_axis_name(room) 
    
    # check if the room name exists and if so add a suffix
    room_name = append_letter(new_room_names, room_name)
    
    new_room_names.append(room_name)
  
# Return the list of X coordinates
OUT = new_room_names

# Assign your output to the OUT variable.
# OUT = IN[0]
# ----------------------------------------
code_block_3 = CodeBlock()
# ---------- code_block_3.designscript (5 lines) ----------
// IN[0] -> Coordinates of the rooms
// IN[1] -> BBox min PT of the floor
// IN[2] -> Grid Spacing
// IN[3] -> BBox max PT of the floor
// IN[4] -> Level Name of the room;
# ----------------------------------------

watch = Watch(room_to_name)

# group: testing
level = Custom[Element.Level](element=all_elements_of_category)  # package Clockwork for Dynamo 1.x; Gets an element's level
number = DoubleInput(1)
getItemAtIndex = List.GetItemAtIndex(list=level, index=number)
name = Level.Name(level=getItemAtIndex)

setNumber = Room.SetNumber(room=all_elements_of_category, value=room_to_name)
